# Grasshopper definition match_ifc_xml_by_nc.gh (Grasshopper 1.0.7)
# plug-ins: Hops

# ifc_parser
panel = Panel("D:\GH_IFC_Project\data\example.ifc")
panel_2 = Panel("D:\GH_IFC_Project\output\01_ifc.json")
# xml_parser
panel_3 = Panel("D:\GH_IFC_Project\data\example.Xml")
panel_4 = Panel("D:\GH_IFC_Project\output\02_xml.json")
hops = Hops(
    XML_File=panel_3,
    Output_JSON=panel_4,
    CacheResultsInMemory=True,
    CacheSolveResults=True,
    RemoteDefinitionLocation="http://127.0.0.1:5000/parse_xml",
    RemoteSolveVersion=(0, 1, 0),
    ShowInput_Enabled=False,
    ShowInput_Path=False,
    SynchronousSolve=True)
hops_2 = Hops(
    IFC_File=panel,
    Output_JSON=panel_2,
    CacheResultsInMemory=True,
    CacheSolveResults=True,
    RemoteDefinitionLocation="http://127.0.0.1:5000/parse_ifc",
    RemoteSolveVersion=(0, 1, 0),
    ShowInput_Enabled=False,
    ShowInput_Path=False,
    SynchronousSolve=True)
panel_5 = Panel(hops)
panel_6 = Panel(hops_2)

# ----
# to find the matching key words
path = FilePath(panel_2)
file = ReadFile(File=path, PerLineParse=True)
panel_7 = Panel(file)

panel_8 = Panel("D:\GH_IFC_Project\output\03_matched.json")

pt = Point()
# matcher
hops_3 = Hops(
    IFC_JSON=panel_2,
    XML_JSON=panel_4,
    Output_JSON=panel_8,
    Output_CSV="D:\GH_IFC_Project\output\03_matched.csv",
    PropertySet="+Träger",
    PropertyKey="Position",
    CacheResultsInMemory=True,
    CacheSolveResults=True,
    RemoteDefinitionLocation="http://127.0.0.1:5000/match_components",
    RemoteSolveVersion=(0, 1, 0),
    ShowInput_Enabled=False,
    ShowInput_Path=False,
    SynchronousSolve=True)
pt_2 = Point()

panel_9 = Panel(hops_3)
path_2 = FilePath(panel_8)
# reader
file_2 = ReadFile(File=path_2, PerLineParse=True)
panel_10 = Panel(file_2)
