# Grasshopper definition match_ifc_xml_by_nc.gh.gh (Grasshopper 1.0.7)
# plug-ins: Hops

panel = Panel("D:\GH_IFC_Project\output\01_ifc.json")
panel_2 = Panel("D:\GH_IFC_Project\output\02_xml.json")
hops = Hops(
    XML_File="D:\GH_IFC_Project\data\17.Xml",
    Output_JSON=panel_2,
    CacheResultsInMemory=True,
    CacheSolveResults=True,
    RemoteDefinitionLocation="http://127.0.0.1:5000/parse_xml",
    RemoteSolveVersion=(0, 1, 0),
    ShowInput_Enabled=False,
    ShowInput_Path=False,
    SynchronousSolve=True)
hops_2 = Hops(
    IFC_File="D:\GH_IFC_Project\data\Dachbaugruppe.ifc",
    Output_JSON=panel,
    CacheResultsInMemory=True,
    CacheSolveResults=True,
    RemoteDefinitionLocation="http://127.0.0.1:5000/parse_ifc",
    RemoteSolveVersion=(0, 1, 0),
    ShowInput_Enabled=False,
    ShowInput_Path=False,
    SynchronousSolve=True)
panel_3 = Panel(hops)
panel_4 = Panel(hops_2)
panel_5 = Panel("D:\GH_IFC_Project\output\03_matched.csv")
hops_3 = Hops(
    IFC_JSON=panel,
    XML_JSON=panel_2,
    Output_JSON="D:\GH_IFC_Project\output\03_matched.json",
    Output_CSV=panel_5,
    PropertySet="+Träger",
    PropertyKey="Position",
    CacheResultsInMemory=True,
    CacheSolveResults=True,
    RemoteDefinitionLocation="http://127.0.0.1:5000/match_components",
    RemoteSolveVersion=(0, 1, 0),
    ShowInput_Enabled=False,
    ShowInput_Path=False,
    SynchronousSolve=True)
path = FilePath(panel_5)
panel_6 = Panel(hops_3)
file = ReadFile(File=path, PerLineParse=True)
panel_7 = Panel(file)
