# Grasshopper definition match_ifc_xml_by_nc_manulcheck.gh (Grasshopper 1.0.7)
# plug-ins: Hops

# xml_parser
panel = Panel("D:\GH_IFC_Project\data\example.Xml")
panel_2 = Panel("D:\GH_IFC_Project\output\02_xml.json")
# ifc_parser
panel_3 = Panel("D:\GH_IFC_Project\data\example.ifc")
panel_4 = Panel("D:\GH_IFC_Project\output\01_ifc.json")
hops = Hops(
    XML_File=panel,
    Output_JSON=panel_2,
    CacheResultsInMemory=True,
    CacheSolveResults=True,
    RemoteDefinitionLocation="http://127.0.0.1:5000/parse_xml",
    RemoteSolveVersion=(0, 1, 0),
    ShowInput_Enabled=False,
    ShowInput_Path=False,
    SynchronousSolve=True)
hops_2 = Hops(
    IFC_File=panel_3,
    Output_JSON=panel_4,
    CacheResultsInMemory=True,
    CacheSolveResults=True,
    RemoteDefinitionLocation="http://127.0.0.1:5000/parse_ifc",
    RemoteSolveVersion=(0, 1, 0),
    ShowInput_Enabled=False,
    ShowInput_Path=False,
    SynchronousSolve=True)

# ----
# ifc&dstv-xml match
# to find the matching key words
path = FilePath(panel_4)
file = ReadFile(File=path, PerLineParse=True)
panel_5 = Panel(file)

panel_6 = Panel(hops)
panel_7 = Panel(hops_2)
panel_8 = Panel("D:\GH_IFC_Project\output\03_matched.json")

pt = Point()
# matcher
hops_3 = Hops(
    IFC_JSON=panel_4,
    XML_JSON=panel_2,
    Output_JSON=panel_8,
    Output_CSV="D:\GH_IFC_Project\output\03_matched.csv",
    PropertySet="+Träger",
    PropertyKey="Position",
    CacheResultsInMemory=True,
    CacheSolveResults=True,
    RemoteDefinitionLocation="http://127.0.0.1:5000/match_components",
    RemoteSolveVersion=(0, 1, 0),
    ShowInput_Enabled=False,
    ShowInput_Path=False,
    SynchronousSolve=True)
pt_2 = Point()

# ----
# reader
path_2 = FilePath(panel_8)
file_2 = ReadFile(File=path_2, PerLineParse=True)
panel_9 = Panel(hops_3)
panel_10 = Panel(file_2)
# case2
panel_11 = Panel("D:\GH_IFC_Project\output\matched_results_2.json")
# case3
panel_12 = Panel("D:\GH_IFC_Project\output\matched_results_3_2.json")

# ----
# ambiguity detection manully check
number_slider = Slider(1, range=1..12)
python = GhPythonScript(path=panel_11, pair_number=Slider(1, range=1..12))  # -> a, pair_id, real_ifc, inverted_ifc, xml, count
# ---------- python: Python ----------
# Inputs:  path (str), pair_number (int, 1-based)
# Outputs: count (int), pair_id ([IFC_ID, XML_ID, NC_Name]),
#          real_ifc (DataTree), inverted_ifc (DataTree), xml (DataTree)

import os, io, json
import Rhino
from Grasshopper import DataTree
from Grasshopper.Kernel.Data import GH_Path

def to_floats(v, dflt):
    try:    return [float(x) for x in v]
    except: return list(dflt)

def to_point(v):  return Rhino.Geometry.Point3d(float(v[0]), float(v[1]), float(v[2]))
def to_vec(v):    return Rhino.Geometry.Vector3d(float(v[0]), float(v[1]), float(v[2]))

def rows_to_branch(objs):
    """objs: [Point/Vector, Vector, Vector] → DataTree {0} 三行"""
    T = DataTree[object]()
    p = GH_Path(0)
    for o in objs:
        T.Add(o, p)
    return T

# 默认输出
count = 0
pair_id = ["", "", ""]
real_ifc     = DataTree[object]()
inverted_ifc = DataTree[object]()
xml          = DataTree[object]()

# 读取 JSON，筛选 NeedManualCheck=True
if path and os.path.exists(path):
    with io.open(path, 'r', encoding='utf-8') as f:
        data = json.load(f)

    if isinstance(data, list):
        rows = [r for r in data if bool(r.get("NeedManualCheck", False))]
        count = len(rows)  # ← True 的总数量（整数）

        if count > 0:
            idx = max(1, min(int(pair_number), count)) - 1  # 夹取 1..count
            r = rows[idx]

            # 业务 ID
            pair_id = [r.get("IFC_ID",""), r.get("XML_ID",""), r.get("NC_Name","")]

            # IFC：三行 = 位置点 / 轴Z向量 / 参考X向量
            loc  = to_floats(r.get("IFC_Location",[0,0,0]), [0,0,0])
            zax  = to_floats(r.get("IFC_Axis",[0,0,1]),     [0,0,1])
            xref = to_floats(r.get("IFC_RefDirection",[1,0,0]), [1,0,0])

            real_ifc     = rows_to_branch([to_point(loc), to_vec(zax), to_vec(xref)])

            # inverted_ifc：第三行换成 -RefDirection
            invx = [-xref[0], -xref[1], -xref[2]] if len(xref)==3 else list(xref)
            inverted_ifc = rows_to_branch([to_point(loc), to_vec(zax), to_vec(invx)])

            # XML：三行 = base 点 / Rx 向量 / Ry 向量
            base = to_floats(r.get("XML_Base",[0,0,0]), [0,0,0])
            rx   = to_floats(r.get("XML_Rx",[1,0,0]),   [1,0,0])
            ry   = to_floats(r.get("XML_Ry",[0,1,0]),   [0,1,0])
            xml  = rows_to_branch([to_point(base), to_vec(rx), to_vec(ry)])
# ---------- end python ----------
# reference pair
python_2 = GhPythonScript(path=panel_11, pair_number=number_slider)  # -> a, pair_id, real_ifc, inverted_ifc, xml, count
# ---------- python_2: Python ----------
# Inputs:  path (str), pair_number (int, 1-based)
# Outputs: count (int), pair_id ([IFC_ID, XML_ID, NC_Name]),
#          real_ifc (DataTree), inverted_ifc (DataTree), xml (DataTree)

import os, io, json
import Rhino
from Grasshopper import DataTree
from Grasshopper.Kernel.Data import GH_Path

def to_floats(v, dflt):
    try:    return [float(x) for x in v]
    except: return list(dflt)

def to_point(v):  return Rhino.Geometry.Point3d(float(v[0]), float(v[1]), float(v[2]))
def to_vec(v):    return Rhino.Geometry.Vector3d(float(v[0]), float(v[1]), float(v[2]))

def rows_to_branch(objs):
    """objs: [Point/Vector, Vector, Vector] → DataTree {0} 三行"""
    T = DataTree[object]()
    p = GH_Path(0)
    for o in objs:
        T.Add(o, p)
    return T

# 默认输出
count = 0
pair_id = ["", "", ""]
real_ifc     = DataTree[object]()
inverted_ifc = DataTree[object]()
xml          = DataTree[object]()

# 读取 JSON，筛选 NeedManualCheck=True
if path and os.path.exists(path):
    with io.open(path, 'r', encoding='utf-8') as f:
        data = json.load(f)

    if isinstance(data, list):
        rows = [r for r in data if not bool(r.get("NeedManualCheck", False))]
        count = len(rows)  # ← True 的总数量（整数）

        if count > 0:
            idx = max(1, min(int(pair_number), count)) - 1  # 夹取 1..count
            r = rows[idx]

            # 业务 ID
            pair_id = [r.get("IFC_ID",""), r.get("XML_ID",""), r.get("NC_Name","")]

            # IFC：三行 = 位置点 / 轴Z向量 / 参考X向量
            loc  = to_floats(r.get("IFC_Location",[0,0,0]), [0,0,0])
            zax  = to_floats(r.get("IFC_Axis",[0,0,1]),     [0,0,1])
            xref = to_floats(r.get("IFC_RefDirection",[1,0,0]), [1,0,0])

            real_ifc     = rows_to_branch([to_point(loc), to_vec(zax), to_vec(xref)])

            # inverted_ifc：第三行换成 -RefDirection
            invx = [-xref[0], -xref[1], -xref[2]] if len(xref)==3 else list(xref)
            inverted_ifc = rows_to_branch([to_point(loc), to_vec(zax), to_vec(invx)])

            # XML：三行 = base 点 / Rx 向量 / Ry 向量
            base = to_floats(r.get("XML_Base",[0,0,0]), [0,0,0])
            rx   = to_floats(r.get("XML_Rx",[1,0,0]),   [1,0,0])
            ry   = to_floats(r.get("XML_Ry",[0,1,0]),   [0,1,0])
            xml  = rows_to_branch([to_point(base), to_vec(rx), to_vec(ry)])
# ---------- end python_2 ----------
panel_13 = Panel(python_2.pair_id)
panel_14 = Panel(python_2.count)
panel_15 = Panel(python.pair_id)
panel_16 = Panel(python.count)
cluster = Cluster(real_ifc=python_2.real_ifc, inverted_x_ifc=python_2.inverted_ifc, xml=python_2.xml)  # -> ifc_element, ifc_plane, matrix, xml_plane, xml_element
cluster_2 = Cluster(real_ifc=python.real_ifc, inverted_x_ifc=python.inverted_ifc, xml=python.xml)  # -> ifc_element, ifc_plane, matrix, xml_plane, xml_element
xml_beam = Geometry(cluster.xml_element)
xml_plane = Geometry(cluster.xml_plane)
ifc_beam = Geometry(cluster.ifc_element)
ifc_plane = Geometry(cluster.ifc_plane)
xml_beam_2 = Geometry(cluster_2.xml_element)
xml_plane_2 = Geometry(cluster_2.xml_plane)
ifc_beam_2 = Geometry(cluster_2.ifc_element)
ifc_plane_2 = Geometry(cluster_2.ifc_plane)
# reference matrix
matrix = TransformMatrix(cluster.matrix, Digits=3)
matrix_2 = TransformMatrix(cluster_2.matrix, Digits=3)

# ----
# case1
panel_17 = Panel("D:\GH_IFC_Project\output\03_matched.json")

# ==== cluster Cluster

# ----
# positive extruded beam
box = CenterBox(Base=PlaneXY(500, 20, 10), X=500, Y=20, Z=10)

# ----
# negative extruded beam
box_2 = CenterBox(Base=PlaneXY(-500, 20, 10), X=500, Y=20, Z=10)

# ----
# ifc with inverted x to calculate transformation
# xml
inverted_x_ifc = ClusterInput()
real_ifc = ClusterInput()
xml = ClusterInput()
item = ListItem(List=inverted_x_ifc, Index=0, Wrap=True)  # -> Item, Item1, Item2
item_2 = ListItem(List=xml, Index=0, Wrap=True)  # -> Item, Item1, Item2
item_3 = ListItem(List=real_ifc, Index=0, Wrap=True)  # -> Item, Item1, Item2
pl = PlaneNormal(Origin=item.Item, ZAxis=item.Item1)
pl_2 = PlaneNormal(Origin=item_3.Item, ZAxis=item_3.Item1)
pl_3 = ConstructPlane(Origin=item_2.Item, XAxis=item_2.Item1, YAxis=item_2.Item2)
align = AlignPlane(Plane=pl, Direction=item.Item2)  # -> Plane, Angle
align_2 = AlignPlane(Plane=pl_2, Direction=item_3.Item2)  # -> Plane, Angle
deplane = DeconstructPlane(Plane=align.Plane)  # -> Origin, XAxis, YAxis, ZAxis
xml_plane = ClusterOutput(pl_3)
ifc_plane = ClusterOutput(align.Plane)
orient = Orient(Geometry=box, Source=PlaneXY(0, 0, 0), Target=pl_3)  # -> Geometry, Transform
orient_2 = Orient(Geometry=box_2, Source=PlaneXY(0, 0, 0), Target=align_2.Plane)  # -> Geometry, Transform
orient_3 = Orient(Geometry=orient.Geometry, Source=pl_3, Target=align.Plane)  # -> Geometry, Transform
ifc_element = ClusterOutput(orient_2.Geometry)
xml_element = ClusterOutput(orient.Geometry)
matrix = ClusterOutput(orient_3.Transform)
